# Dynamo graph AUTO DIMENSION SETOUTS.dyn (Dynamo 1.2.1.3083)

# group: USER INTERFACE
# note: INPUT + CONTROL

# group: DESIGN
# note: BACK-END FUNCTIONALITY

# group: DIMENSIONS CONCRETE SETOUT PLAN
# note: CREATED BY:
# CREATED: 2018.08.15
# VERSION: 1.0
# LAST EDITED: 2018.12.20
# DYNAMO VERSION: Dynamo 1.2.0
# PACKAGES:
# None
# NOTES:
# <NOTES>

# group: INSTRUCTIONS
# note: INSTRUCTIONS:
# WARNING:
# ROOMS THAT HAVE 4 SIDES AS BOUNDARIES WILL BE DIMENSIONED ONLY IN 2 SIDES. TO OVERRRIDE THIS FILTER, REWIRE THE WIP GROUP (ORANGE).
# THE SCRIPT DOESN'T DIMENSION CURVED ELEMENTS.
# 1. Enter View's Namein input field. This is the view where dimensions will be.
# 2. Hit Run.
# 3. Ignore errors as long as you get some dimensions
# 4. Otherwise ask for help

# group: WIP
# note: USE:
# FOR UNFINISHED OR UNTESTED
# NODE BLOCKS
# note: WIP

# group: COMMENTS
# note: USE:
# FOR ANY COMMENTS OR PROJECT INFO
# note: COMMENTS

# group: TO REVIT
# note: USE:
# FOR ANY NODE THAT
# EXPORTS DATA TO REVIT
# note: TO REVIT

# group: INPUT
# note: USE:
# FOR FIXED INPUTS, LIKE FILE PATHS OR FIXED NUMBERS OR ELEMENTS THAT NEEDS TO BE
# TYPED BY THE FINAL USER
# note: INPUT

# group: CONTROL
# note: FIXED INPUTS THAT DICTATE WHAT
# THE SCRIPT IS USEFUL FOR
# note: CONTROL

# group: DESIGN
# note: USE:
# FOR GENERAL DEFINITIONS OF NODE BLOCKS
# note: DESIGN

# group: Select all views
code_block = CodeBlock { "OST_Views"; }
byName = Category.ByName(code_block)
all_elements_of_category = ElementsOfCategory(byName)

view_s_name = StringInput("A03.04_GENERAL ARRANGEMENT PLAN - L00")

# group: FILTER VIEWS
string_from_object = FromObject(all_elements_of_category)
code_block_2 = CodeBlock { true; }
contains = String.Contains(str=string_from_object, searchFor=view_s_name, ignoreCase=code_block_2)
filterByBoolMask = List.FilterByBoolMask(list=all_elements_of_category, mask=contains)
firstItem = List.FirstItem(filterByBoolMask.in)

# group: Select all rooms
code_block_3 = CodeBlock { "OST_Rooms"; }
byName_2 = Category.ByName(code_block_3)
all_elements_of_category_2 = ElementsOfCategory(byName_2)

# group: Filter Setout rooms
code_block_4 = CodeBlock { "Room Setout"; }
getParameterValueByName = Element.GetParameterValueByName(element=all_elements_of_category_2, parameterName=code_block_4)
convertto_true_false_list = Python(IN[0]=getParameterValueByName)
# ---------- convertto_true_false_list.python (16 lines) ----------
import clr
clr.AddReference('ProtoGeometry')
from Autodesk.DesignScript.Geometry import *
#The inputs to this node will be stored as a list in the IN variables.
data = IN

resultList = list()

for element in data[0]:
	if element == 1:
		resultList.append(True)
	else:
		resultList.append(False)

#Assign your output to the OUT variable.
OUT = resultList
# ----------------------------------------
filterByBoolMask_2 = List.FilterByBoolMask(list=all_elements_of_category_2, mask=convertto_true_false_list)

# group: Get Room Boundaries
finishBoundary = Room.FinishBoundary(filterByBoolMask_2.in)
simplify_curves = Custom[Simplify Curves](curveLoop=finishBoundary)  # Simplify Curves
flatten = Flatten(simplify_curves)

# group: Reduce 4 lines to 2
code_block_5 = CodeBlock { 1; }
flatten_2 = List.Flatten(list=simplify_curves, amt=code_block_5)
count = Count(simplify_curves@L2)
code_block_6 = CodeBlock { 4; }
eq = count == code_block_6
filter_rectangles = Python(IN[0]=flatten_2, IN[1]=eq)
# ---------- filter_rectangles.python (19 lines) ----------
import clr
clr.AddReference('ProtoGeometry')
from Autodesk.DesignScript.Geometry import *
#The inputs to this node will be stored as a list in the IN variables.
lines = IN[0]
boolean = IN[1]

i = -1
linesList = []

for truthy in boolean:
	i = i + 1
	if truthy == True:
		linesList.append(lines[i])

#Assign your output to the OUT variable.


OUT = linesList
# ----------------------------------------
code_block_7 = CodeBlock { -2; }
dropItems = List.DropItems(list=filter_rectangles@L2, amount=code_block_7)
filter_rest_of_lines = Python(IN[0]=flatten_2, IN[1]=eq)
# ---------- filter_rest_of_lines.python (19 lines) ----------
import clr
clr.AddReference('ProtoGeometry')
from Autodesk.DesignScript.Geometry import *
#The inputs to this node will be stored as a list in the IN variables.
lines = IN[0]
boolean = IN[1]

i = -1
linesList = []

for truthy in boolean:
	i = i + 1
	if truthy == False:
		linesList.append(lines[i])

#Assign your output to the OUT variable.


OUT = linesList
# ----------------------------------------
join = List.Join(dropItems, filter_rest_of_lines)
flatten_3 = Flatten(join)

# group: Get curve start and end point
code_block_8 = CodeBlock { 0..1; }
pointAtParameter = Curve.PointAtParameter(curve=flatten_3, param=code_block_8, lacing=CrossProduct)
normalAtParameter = Curve.NormalAtParameter(curve=flatten_3, lacing=CrossProduct)

# group: Create model line as reference for dimensions
number = DoubleInput(1)
byStartPointDirectionLength = Line.ByStartPointDirectionLength(startPoint=pointAtParameter, direction=normalAtParameter, length=number)
byCurve = ModelCurve.ByCurve(byStartPointDirectionLength)
flatten_4 = Flatten(byStartPointDirectionLength)

dimension_offset = DoubleInput(250)

# group: Create a line offset for dimension location
offset = Curve.Offset(curve=flatten_3, distance=dimension_offset)
byCurve_2 = ModelCurve.ByCurve(offset)
code_block_9 = CodeBlock(e=byCurve_2) { e.Curve; }

# group: WRITE RESULTS TO REVIT
byElements = Dimension.ByElements(firstItem, byCurve, code_block_9)

join_2 = List.Join(byCurve_2, byCurve)
flatten_5 = Flatten(join_2)

# group: Change helper lines to invisible
code_block_10 = CodeBlock { "Line Style"; }
code_block_11 = CodeBlock { "Hidden Lines"; }
get_line_style_by_name = Custom[Get Line Style by Name](Name=code_block_11)  # This node will return a line style object by its name. Line styles can be either Drafting or Model Line Property.
setParameterByName = Element.SetParameterByName(element=flatten_5, parameterName=code_block_10, value=get_line_style_by_name)
code_block_12 = CodeBlock { "Invisible Lines For Dimensions"; }
fromElements = Custom[Group.FromElements](elements=setParameterByName, groupName=code_block_12)  # Creates a group from a list of Revit elements
