# Dynamo graph SCHEDULE REVISION HISTORY.dyn "Schedule Revision History" (Dynamo 2.0.2.6826)

# group: BACK-END
# note: BACK-END FUNCTIONALITY

# group: WIP
# note: USE:
# FOR UNFINISHED OR UNTESTED
# BLOCKS OF CODE
# note: WIP

# group: TO REVIT
# note: USE:
# FOR ANY GROUP THAT
# WRITES DATA TO REVIT
# note: TO REVIT

# group: DESIGN
# note: USE:
# FOR BLOCKS OF CODE THAT DO A SPECIFIC TASK
# note: DESIGN

# group: COMMENTS
# note: USE:
# FOR ANY COMMENTS OR PROJECT INFO
# note: COMMENTS

# group: USER INTERFACE
# note: INPUT

# group: INPUT
# note: USE:
# INPUTS THAT ARE REQUIRED TO BE
# SET BY THE USER
# note: INPUT

# group: INSTRUCTIONS
# note: INSTRUCTIONS:
# 1. The INPUT section relates to the Excel file that contains all the revisions
# 2. Select file path for the Excel file
# 3. Fill in the sheet parameters to be exported with the revision history
# 4. Click Run

# group: SCHEDULE ALL REVISIONS ON SHEETS
# note: CREATED BY:
# CREATED: 2018-08-21
# VERSION:
# LAST EDITED: 2019-01-21
# DYNAMO VERSION: 2.0
# PACKAGES:
# Archi-lab, Clockwork
# NOTES:

# group: INPUT
folder_to_save_schedule_in_excel = Filename("D:\REVISION HISTORY.XLS")  # graph input
sheet_parameter_to_schedule = StringInput("Sheet Number")  # graph input
sheet_parameter_to_schedule_2 = StringInput("Sheet Name")  # graph input

# group: PARAMETERS NAME TO STORE REVISIONS
code_block = CodeBlock { "Revision"; }
code_block_2 = CodeBlock { true; }
# note: Archi-lab
get_all_revisions = Custom[Get All Revisions](RunIt=code_block_2)  # This node will return all Revisions currently defined in the mode.
count = List.Count(list=get_all_revisions)
code_block_3 = CodeBlock(nm=count) { 1..nm..1; }
string_from_object = FromObject(obj=code_block_3)
code_block_4 = CodeBlock(a=code_block, b=string_from_object) { a + " " + b; }

# group: SELECT ALL SHEETS
code_block_5 = CodeBlock { Category.ByName("OST_Sheets"); }
all_elements_of_category = ElementsOfCategory(Category=code_block_5)

# group: FILTER SHEETS BY 'APPEARS IN SHEET LIST' PARAMETER
code_block_6 = CodeBlock { "Appears In Sheet List"; }
getParameterValueByName = Element.GetParameterValueByName(element=all_elements_of_category, parameterName=code_block_6)
code_block_7 = CodeBlock { false; }
eq = getParameterValueByName == code_block_7
filterByBoolMask = List.FilterByBoolMask(list=all_elements_of_category, mask=eq)

# group: SHEET PARAMETERS TO SCHEDULE
getParameterValueByName_2 = Element.GetParameterValueByName(element=filterByBoolMask.out, parameterName=sheet_parameter_to_schedule)
getParameterValueByName_3 = Element.GetParameterValueByName(element=filterByBoolMask.out, parameterName=sheet_parameter_to_schedule_2)
# note: Clockwork
scale = Custom[Sheet.Scale](sheet=filterByBoolMask.out)  # Returns the scale of a given sheet

# group: RETRIEVE ALL REVISIONS IN PROJECT
code_block_8 = CodeBlock { true; }
# note: Archi-lab
get_all_revisions_2 = Custom[Get All Revisions](RunIt=code_block_8)
revision_properties = Custom[Revision Properties](Revision=get_all_revisions_2)  # This node will return some most common Revision properties like Description or Issue Date.

# group: RETRIVE REVISIONS ON SHEETS
revisions = archilab.Revit.Views.Sheets.Revisions(sheet=filterByBoolMask.out)
setIntersection = List.SetIntersection(list1=revisions, list2=get_all_revisions_2)
contains = List.Contains(list=setIntersection, item=get_all_revisions_2, lacing=CrossProduct)
python_script = Python(IN[0]=contains, IN[1]=revision_properties.Description)
# ---------- python_script.python (28 lines) ----------
# Enable Python support and load DesignScript library
import clr
clr.AddReference('ProtoGeometry')
from Autodesk.DesignScript.Geometry import *

# The inputs to this node will be stored as a list in the IN variables.
boolMask = IN[0]
revDescr = IN[1]

# Place your code below this line
result = list()
sublistResult = list()
i = 0

for list in boolMask:
	for element in list:
		if element == True:
			sublistResult.append(revDescr[i])
		else:
			sublistResult.append("")
		i = i + 1
		
	result.append(sublistResult)
	sublistResult = []
	i = 0
	
# Assign your output to the OUT variable.
OUT = result
# ----------------------------------------

# group: DATA TO EXPORT TO EXCEL
code_block_9 = CodeBlock { "Scale"; }
list_create = List.Create(item0=sheet_parameter_to_schedule, item1=sheet_parameter_to_schedule_2, item2=code_block_9)
join = List.Join(list0=list_create, list1=code_block_4)
flatten = List.Flatten(list=join@L3)
create = List.Create(item0=getParameterValueByName_2, item1=getParameterValueByName_3, item2=scale)
transpose = List.Transpose(lists=python_script)
join_2 = List.Join(list0=create, list1=transpose)
# note: Clockwork
sortListOfLists = Custom[List.SortListOfLists](seq=join_2)  # Sorts a list of lists by one of its sublists
transpose_2 = List.Transpose(lists=sortListOfLists)
join_3 = List.Join(list0=flatten, list1=transpose_2)

# group: EXPORT SCHEDULE TO EXCEL
code_block_10 = CodeBlock { "Revision History"; 1; 0; true; }
exportExcel = Data.ExportExcel(filePath=folder_to_save_schedule_in_excel, sheetName=code_block_10.out0, startRow=code_block_10.out1, startCol=code_block_10.out2, data=join_3, overWrite=code_block_10.out3)

# group: SET NEW VALUES IN PARAMETERS
count_2 = List.Count(list=filterByBoolMask.out)
cycle = List.Cycle(list=code_block_4, amount=count_2)
chop = List.Chop(list=cycle, lengths=count)
setParameterByName = Element.SetParameterByName(element=filterByBoolMask.out, parameterName=chop, value=python_script)

# group: CHECK IF PARAMETERS ARE ALREADY SET UP IN SHEETS
firstItem = List.FirstItem(list=all_elements_of_category)
parameters = Element.Parameters(element=firstItem)
name = Parameter.Name(parameter=parameters)
python_script_2 = Python(IN[0]=code_block_4, IN[1]=name)
# ---------- python_script_2.python (13 lines) ----------
# The inputs to this node will be stored as a list in the IN variables.
revList = IN[0]
paraList = IN[1]

# Place your code below this line
result = list()

for element in revList:
	if element not in paraList:
		result.append(element)
	
# Assign your output to the OUT variable.
OUT = result
# ----------------------------------------

# group: CREATE PARAMETERS TO STORE THE REVISIONS
parameter_groups = ParameterGroupUi(index=52)
code_block_11 = CodeBlock(group=parameter_groups) { "Sheets1"; "Text"; group; true; }
createProjectParameter = Parameter.CreateProjectParameter(parameterName=python_script_2, groupName=code_block_11.out0, type=code_block_11.out1, group=code_block_11.group, instance=code_block_11.out3, categoryList=code_block_5)
# note: Clockwork
passthrough = Custom[Passthrough](passThrough=python_script_2, waitFor=createProjectParameter)  # Forces a sequential order of execution. The node wired into the output of the Passthrough node will be executed *after* the node wired into the waitFor input (e.g. important for some Revit operations). The value of the passThrough input will be passed on to the node wired into the output port of the Passthrough node.
